# Grasshopper definition RhinoInsideUnity.gh (Grasshopper 1.0.7)

number_slider = Slider(40, range=0..100)
number_slider_2 = Slider(58, range=0..100)
cir = Circle(Plane=PlaneXY(0, 0, 0), Radius=Slider(4, range=0..10))
pi = Pi(Factor=Slider(7.5, range=0..10))
range = Range(Domain=Slider(10, range=0..10), Steps=number_slider_2)
range_2 = Range(Domain=pi, Steps=number_slider_2)
Z = UnitZ(Factor=range)
sin = Sine(Value=range_2)
dom = ConstructDomain(DomainStart=Slider(1, range=0..1), DomainEnd=Slider(1.19, range=0..2))
bnd = Bounds(Numbers=sin)
remap = RemapNumbers(Value=sin, Source=bnd, Target=dom)  # -> Mapped, Clipped
scale = Scale(Geometry=cir, Center=Point(0, 0, 0), Factor=remap.Mapped)  # -> Geometry, Transform
move = Move(Geometry=scale.Geometry, Motion=Z)  # -> Geometry, Transform
lng = ListLength(List=move.Geometry)
pi_2 = Pi(Factor="2")
series = Series(Start=0, Step=1, Count=lng)
division = Division(A=pi_2, B=number_slider)
divide = DivideCurve(Curve=move.Geometry, Count=number_slider, Kinks=False)  # -> simplify(Points), Tangents, Parameters
mod = Modulus(A=series, B="2")
multiplication = Multiplication(A=division, B="0.5")
subset = SubList(List=flatten(divide.Points), Domain="1", Wrap=True)  # -> List, Index
multiplication_2 = Multiplication(A=mod, B=multiplication)  # -> graft(Result)
Z_2 = UnitZ(Factor=1)
pline = PolyLine(Vertices=subset.List, Closed=False)
rotate = Rotate(Geometry=divide.Points, Angle=multiplication_2, Plane=PlaneXY(0, 0, 0))  # -> Geometry, Transform
vrot = Rotate(Vector=divide.Tangents, Axis=Z_2, Angle=multiplication_2)
Z_3 = UnitZ(Factor=1)
pi_3 = Pi(Factor="0.5")
len = Length(Curve=pline)
vrot_2 = Rotate(Vector=vrot, Axis=Z_3, Angle=pi_3)
multiplication_3 = Multiplication(A=len, B="0.5")
pl = ConstructPlane(Origin=rotate.Geometry, XAxis=vrot, YAxis=vrot_2)
item = ListItem(List=Z, Index="1", Wrap=True)
multiplication_4 = Multiplication(A=multiplication_3, B=Slider(0.66, range=0..1))
multiplication_5 = Multiplication(A=multiplication_3, B=Slider(0.76, range=0..1))
multiplication_6 = Multiplication(A=item, B="0.5")
box = CenterBox(Base=pl, X=multiplication_5, Y=multiplication_4, Z=multiplication_6)
mesh = MeshBrep(
    Brep=box,
    Settings={GridMaxCount=0, GridMinCount=16, JaggedSeams=False, MaxEdgeLength=0, MinEdgeLength=0.0001, MinTolerance=0, Refine=True, RefineAngle=0, RelativeTolerance=0.65, SimplePlanes=True, Tolerance=0})
number_slider_3 = Slider(5, range=0..10)
receive = CSharpScript()  # -> A
# ---------- receive: C# ----------
    Register(Component);

    A = randomSeed;
# ---------- receive: C# additional code ----------
  double randomSeed = 0.0;
  bool registered = false;
  IGH_Component comp = null;

  void Register(IGH_Component component)
  {
    if(!registered)
    {
      Rhino.Runtime.HostUtils.RegisterNamedCallback("ToGrasshopper", ToGrasshopper);

      comp = component;

      registered = true;
    }
  }

  void ToGrasshopper(object sender, Rhino.Runtime.NamedParametersEventArgs args)
  {
    double val;
    if (args.TryGetDouble("randomSeed", out val))
      randomSeed = val;

    comp.ExpireSolution(true);
  }
# ---------- end receive ----------
flatten = FlattenTree(Tree=mesh, Path="{0}")
lng_2 = ListLength(List=flatten)
random = Random(Range=number_slider_3, Number=lng_2, Seed=receive, Integers=True)
division_2 = Division(A=random, B=number_slider_3)
gradient = Gradient(
    LowerLimit=0,
    UpperLimit=1,
    Parameter=division_2,
    stops=[0: RGB(80, 55, 25), 0.5: RGB(159, 65, 29), 1: RGB(174, 166, 129)])
graft = GraftTree(Tree=flatten, IncludeEmptyLists=True, IncludeNullItems=True)
graft_2 = GraftTree(Tree=gradient, IncludeEmptyLists=True, IncludeNullItems=True)
mcol = MeshColours(Mesh=graft, Colours=graft_2)
mjoin = MeshJoin(Meshes=flatten(mcol))
filter = StreamFilter(Gate=Slider(1, range=0..1), Stream0=mcol, Stream1=mjoin)  # -> flatten(Stream)
demesh = DeconstructMesh(Mesh=filter)  # -> Vertices, Faces, Colours, Normals
c_script = CSharpScript(mesh=filter)  # inputs mesh: list of Mesh
# ---------- c_script: C# usings ----------
using System.Linq;
# ---------- c_script: C# ----------
    using(var args = new Rhino.Runtime.NamedParametersEventArgs())
    {
      args.Set("mesh", mesh.ToArray());
      Rhino.Runtime.HostUtils.ExecuteNamedCallback("Unity:FromGrasshopper", args);
    }
# ---------- end c_script ----------
